# Grasshopper definition grasshopper.gh (Grasshopper 0.9.76)

crv = Curve(<curve referenced from the Rhino model>)
pi = Pi(Factor=1)
divide = DivideCurve(Curve=crv, Count=Slider(100, range=0..100), Kinks=False)  # -> Points, Tangents, Parameters
rad = Radians(Degrees=Slider(90, range=0..100))
Z = UnitZ(Factor=1)
bnd = Bounds(Numbers=divide.Parameters)
dom = ConstructDomain(DomainStart=0, DomainEnd=pi)
vrot = Rotate(Vector=divide.Tangents, Axis=Z, Angle=rad)
remap = RemapNumbers(Value=divide.Parameters, Source=bnd, Target=dom)  # -> Mapped, Clipped
sin = Sine(Value=remap.Mapped)
vdis = VectorDisplay(Anchor=divide.Points, Vector=vrot)
sin_2 = Sine(Value=remap.Mapped)
multiplication = Multiplication(A=sin, B=Slider(2.563, range=0..30))
amp = Amplitude(Vector=vrot, Amplitude=multiplication)
move = Move(Geometry=divide.Points, Motion=amp)  # -> Geometry, Transform
pt = Point(move.Geometry)
pt_2 = Point(divide.Points)
multiplication_2 = Multiplication(A=sin_2, B=Slider(30, range=0..30))
panel = Panel(pt_2)
panel_2 = Panel(sin)
multiplication_3 = Multiplication(A=multiplication_2, B=-1)
crv_2 = Curve(crv)
intcrv = Interpolate(Vertices=move.Geometry, Degree=3, Periodic=False, KnotStyle=1)  # -> Curve, Length, Domain
Y = UnitY(Factor=multiplication_3)
crv_3 = Curve(flatten([crv_2, intcrv.Curve]))
move_2 = Move(Geometry=pt, Motion=Y)  # -> Geometry, Transform
move_3 = Move(Geometry=pt_2, Motion=Y)  # -> Geometry, Transform
panel_3 = Panel(pt)
loft = Loft(Curves=crv_3, Options={Adjust=False, Closed=False, LoftEnds=0, LoftSimp=0, LoftType=0, Rebuild=10, Refit=0.01})
intcrv_2 = Interpolate(Vertices=move_2.Geometry, Degree=3, Periodic=False, KnotStyle=1)  # -> Curve, Length, Domain
intcrv_3 = Interpolate(Vertices=move_3.Geometry, Degree=3, Periodic=False, KnotStyle=1)  # -> Curve, Length, Domain
panel_4 = Panel(loft)
pt_3 = Point(move_2.Geometry)
pt_4 = Point(move_3.Geometry)
mesh = MeshBrep(
    Brep=loft,
    Settings={GridMaxCount=0, GridMinCount=16, JaggedSeams=False, MaxEdgeLength=0, MinEdgeLength=0.0001, MinTolerance=0, Refine=True, RefineAngle=0, RelativeTolerance=0.65, SimplePlanes=True, Tolerance=0})
loft_2 = Loft(
    Curves=flatten([intcrv_2.Curve, intcrv_3.Curve]),
    Options={Adjust=False, Closed=False, LoftEnds=0, LoftSimp=0, LoftType=0, Rebuild=10, Refit=0.01})
panel_5 = Panel(pt_3)
panel_6 = Panel(pt_4)
